# Grasshopper definition creativeML_arSketchNet.gh (Grasshopper 1.0.7)
# plug-ins: Pancake

path = FilePath("C:\Users\arvis\OneDrive\Desktop\Harvard\creativeML\ref\t_chair0.obj")
pcimportobj = ImportOBJ(File=path, MapYtoZ=False, LastSaveLocalization="neutral,N")
generate_sketch = BooleanToggle(True)
chair = Mesh(pcimportobj)
mesh_to_sketch_python_script = GhPythonScript(
    mesh=chair,
    n_populate=Slider(40, range=0..1000),
    simplify=Slider(0, range=0..1000),
    curvify=Slider(100, range=0..1000),
    smoothness=Slider(3, range=0..3),
    generate_sketch=generate_sketch)  # -> error, sketch_curve, mesh_bbox; inputs mesh: Mesh, n_populate: Int32, simplify: Int32, curvify: Int32, smoothness: Int32, generate_sketch: Boolean
# ---------- mesh_to_sketch_python_script: Python ----------
__author__ = "vishal"
__version__ = "2022.05.14"

import rhinoscriptsyntax as rs
import ghpythonlib.components as ghc

if generate_sketch:
    if not mesh:
        error = "Missing mesh to generate sketch!"
    else:
        sampled_points = ghc.PopulateGeometry(mesh,n_populate,1)
        start_point = sampled_points[0]
        flow_points = ghc.Pufferfish.PointSortItems(start = start_point,points = sampled_points)[2]
        flow_p_line = ghc.PolyLine(flow_points,False)
        reduced_flow_line = ghc.Reduce(flow_p_line, simplify)[0]
        curve_points = ghc.DivideCurve(reduced_flow_line, curvify,False)[0]
        sketch_curve = ghc.Interpolate(curve_points,smoothness,False,1)[0]
        mesh_bbox = ghc.BoundingBox(mesh, ghc.XYPlane(ghc.ConstructPoint(0,0,0)))[0]
        error = "Sketch successfully generated!"
else:
    error = "Set generate_sketch to True!"
# ---------- end mesh_to_sketch_python_script ----------
panel = Panel(mesh_to_sketch_python_script.error)
sketch_curve = Curve(mesh_to_sketch_python_script.sketch_curve)
visualize_stroke = BooleanToggle(True)
pl = Plane(PlaneXY(0, 0, 0))
sketch_to_sdf_visualizer_python_script = GhPythonScript(
    sketch_curve=sketch_curve,
    mesh_bbox=mesh_to_sketch_python_script.mesh_bbox,
    sdf_vector_size=Slider(128, range=0..1000),
    visualize_stroke=visualize_stroke,
    stroke_visualizer=Slider(0, range=0..1))  # -> out, sketch_sdf_vector, sketch_sdf_normalized, stroke; inputs sketch_curve: Curve, mesh_bbox: Box, visualize_stroke: Boolean
# ---------- sketch_to_sdf_visualizer_python_script: Python ----------
__author__ = "arvis"
__version__ = "2022.05.14"

import rhinoscriptsyntax as rs
import ghpythonlib.components as ghc
import math

sketch_points = ghc.DivideCurve(sketch_curve,sdf_vector_size-1,False)[0]
mesh_centroid = ghc.BoxProperties(mesh_bbox)[0]
dists = []
for i in range(len(sketch_points)):
    d = ghc.Distance(mesh_centroid,sketch_points[i])
    dists.append(d)

sketch_sdf_vector = dists
sketch_sdf_normalized = ghc.RemapNumbers(dists,ghc.Bounds(dists),ghc.ConstructDomain(0,1))[0]

if visualize_stroke:
    stroke_index = ghc.RemapNumbers(stroke_visualizer,ghc.ConstructDomain(0,1),ghc.ConstructDomain(0,sdf_vector_size))[0]
    stroke_index = int(math.ceil(stroke_index))
    if(stroke_index < 3):
        stroke = None
    else:
        stroke = ghc.Interpolate(sketch_points[:stroke_index],3,False,1)[0]
else:
    stroke = None
# ---------- end sketch_to_sdf_visualizer_python_script ----------
sketch_to_voxel_python_script = GhPythonScript(
    sketch_curve=sketch_curve,
    mesh_bbox=mesh_to_sketch_python_script.mesh_bbox,
    voxel_density=Slider(200, range=0..1000),
    voxel_size=Slider(0.1, range=0..1),
    voxel_plane=pl,
    generate_voxel=Toggle(True))  # -> error, sketch_voxels; inputs sketch_curve: Curve, mesh_bbox: Brep, voxel_density: Int32, voxel_plane: Plane, generate_voxel: Boolean
# ---------- sketch_to_voxel_python_script: Python ----------
__author__ = "arvis"
__version__ = "2022.05.14"

import rhinoscriptsyntax as rs
import ghpythonlib.components as ghc

if generate_voxel:
    #Sketch curve to Voxel
    if not sketch_curve:
        error = "Missing sketch_curve to generate voxels!"
    else:
        curve_points = ghc.DivideCurve(sketch_curve,voxel_density,False)[0]
        sketch_voxels = ghc.Pufferfish.VoxelMesh(curve_points,voxel_plane,voxel_size,voxel_size,voxel_size,False)
        error = "Voxels successfully generated!"
else:
    error = "Set generate_voxel to True!"
# ---------- end sketch_to_voxel_python_script ----------
panel_2 = Panel(sketch_to_voxel_python_script.error)
sketch_voxels = Mesh(sketch_to_voxel_python_script.sketch_voxels)
panel_3 = Panel(sketch_to_sdf_visualizer_python_script.sketch_sdf_vector)
stroke = Curve(sketch_to_sdf_visualizer_python_script.stroke)
panel_4 = Panel(sketch_to_sdf_visualizer_python_script.sketch_sdf_normalized)
